vi "Main.gviweb"   [LabVIEW NXG 5.1.0]
panel controls:
  "Send Log": bool
  "Stop Test": bool
  "Start Test": bool
  "System": i32
panel indicators:
  "Files Sent": f64
  "Buffer": f64
  "Temperature History": f64[][]
  "Testing": bool
  "System Status": string
  "Memory Percentage Used": f64
  "Disk Percentage Used": f64
  "Temperature Current Values": f64[]
  "Application Status": string
  "Last Updated": timestamp
uses:
  NI::Skyline::Configuration::Open Configuration.gvi
  Application::Filter Systems by Package.gviweb
  Application::Get System Info.gviweb
  Application::Read AI.gviweb
  NI::Skyline::TagHTTP::Multi Read.gvi
  NI::Skyline::TagHTTP::Configure Tag History Window (Count).gvi
  NI::Skyline::TagHTTP::Multi Read History 2.gvi
  Application::Read Health.gviweb
  NI::Skyline::MessageHTTP::Open.gvi
  NI::Skyline::MessageHTTP::Publish.gvi
  NI::Skyline::MessageHTTP::Close.gvi
diagram:
  w1 = ""  # Server
  call "Open Configuration.gvi"(server url=w1, username="", password="") -> (configuration=w2, error out=w3)
  call "Filter Systems by Package.gviweb"(configuration in=w2, package="crio-test-cell", error in=w3) -> (configuration out=w4, systems=w5, error out=w6)
  for {
    w7 = each element of w5
    Property Node(instance in=w7) -> ("alias"=w9)
    append w9 to w8
  }
  Property Node(instance in=reference to "System", "Items"=w8, "Value"=0, error in=w6) -> (error out=w10)
  while {
    Property Node(instance in=reference to "System", error in=w10) -> ("Items"=w11, error out=w12)
    Array Index(array=w11) -> (out0[$System]=w13)
    call "Get System Info.gviweb"(configuration in=w4, System=w13, error in=w12) -> (State=w14, configuration out=w15, ID=w16)
    event (timeout = 500) {
      on "Timeout" {
        case (w14) {
          frame "Disconnected", Default {
            Property Node(instance in=reference to "Testing", "Value"=FALSE)
            w17 = TRUE
          }
          frame "Connected" {
            Get Current Time() -> (current time=w18)
            call "Read AI.gviweb"(configuration=w15, minion id=w16) -> (tags=w19, number of tags=w20)
            Timestamp Subtract(x=w18, y=1000) -> w21
            case (w20) {
              frame 0 {
                w22 = f64[][] []
                w23 = f64[] []
              }
              frame 1, Default {
                call "Multi Read.gvi"(tags in=w19) -> (tag clusters=w24)
                call "Configure Tag History Window (Count).gvi"(start=w21, end=w18, newest first?=FALSE) -> (history window=w25)
                call "Multi Read History 2.gvi"(tags in=w19, window=w25) -> (values=w26)
                for {
                  w27 = each element of w26
                  w28 = each element of w24
                  Property Node(instance in=w27) -> ("Values"=w29)
                  for {
                    w30 = each element of w29
                    Scan Value(format string="%f", string=w30) -> (value=w32)
                    append w32 to w31
                  }
                  Property Node(instance in=w28) -> ("Value"=w33)
                  Scan Value(format string="%f", string=w33) -> (value=w34)
                  append w31 to w22
                  append w34 to w23
                }
              }
            }
            $"Temperature History" <- w22
            $"Temperature Current Values" <- w23
            call "Read Health.gviweb"(configuration=w15, minion id=w16) -> (tags=w35)
            for {
              w36 = each element of w35
              Property Node(instance in=w36) -> ("Path"=w37, "Value"=w38, "Time Stamp"=w39)
              Search Or Split String(search string/char=".", string=w37) -> (match + rest of string=w40)
              case (w40) {
                frame ".Health.Disk.UsePercentage" {
                  Scan Value(format string="%f", string=w38) -> (value=w41)
                  $"Disk Percentage Used" <- w41
                }
                frame ".Health.Memory.UsePercentage" {
                  Scan Value(format string="%f", string=w38) -> (value=w42)
                  $"Memory Percentage Used" <- w42
                }
                frame ".cRIO_Test_Cell.files_sent" {
                  Scan Value(format string="%d", string=w38) -> (value=w43)
                  $"Files Sent" <- w43
                }
                frame ".cRIO_Test_Cell.buffer" {
                  Scan Value(format string="%d", string=w38) -> (value=w44)
                  $Buffer <- w44
                }
                frame ".cRIO_Test_Cell.testing" {
                  case (w38) {
                    frame "False", Default {
                      w45 = FALSE
                    }
                    frame "True" {
                      w45 = TRUE
                    }
                  }
                  $Testing <- w45
                }
                frame ".TestMonitor.0.Status" {
                  $"Application Status" <- w38
                  $"Last Updated" <- w39
                }
                frame Default { }
              }
            }
            w17 = FALSE
          }
        }
        Property Node(instance in=reference to "Stop Test", "Disabled"=w17)
        Property Node(instance in=reference to "Start Test", "Disabled"=w17)
        Property Node(instance in=reference to "Send Log", "Disabled"=w17)
      }
      on "Send Log" Value changed {
        call "Open.gvi"(configuration=w15) -> (message session=w46, error out=w47)
        call "Publish.gvi"(message session in=w46, topic=w16, message="Send File", error in=w47) -> (message session out=w48, error out=w49)
        call "Close.gvi"(message session=w48, error in=w49)
      }
      on "Start Test" Value changed {
        call "Open.gvi"(configuration=w15) -> (message session=w50, error out=w51)
        call "Publish.gvi"(message session in=w50, topic=w16, message="Start Test", error in=w51) -> (message session out=w52, error out=w53)
        call "Close.gvi"(message session=w52, error in=w53)
      }
      on "Stop Test" Value changed {
        call "Open.gvi"(configuration=w15) -> (message session=w54, error out=w55)
        call "Publish.gvi"(message session in=w54, topic=w16, message="Stop Test", error in=w55) -> (message session out=w56, error out=w57)
        call "Close.gvi"(message session=w56, error in=w57)
      }
      on "System" Value changed {
        Property Node(instance in=reference to "Testing", "Value"=FALSE)
        Property Node(instance in=reference to "Last Updated", "Value"=1904-01-01T00:00:00Z)
        Property Node(instance in=reference to "Files Sent", "Value"=0)
        Property Node(instance in=reference to "Buffer", "Value"=0)
        Property Node(instance in=reference to "Application Status", "Value"="")
      }
    }
    $"System Status" <- w14
    stop if FALSE
  }
